# Dynamo graph ChangeSysPath.dyn (Dynamo 2.3.0.5885)

string = StringInput("Part1_CreatePointList.py")  # graph input
file_from_path = FileObject(path=string)
readText = FileSystem.ReadText(file=file_from_path)

# group: Reoad
reload = BoolSelector(true)

code_block = CodeBlock { false; }
reverse = BoolSelector(false)  # graph input
checkId = BoolSelector(false)  # graph input
python_script_from_string = PythonStringNode(script=readText, IN[0]=file_from_path, IN[1]=reload, IN[2]=code_block, IN[3]=reverse, IN[4]=checkId)
string_2 = StringInput("ChangeSysPath.py")  # graph input
calculate_all = BoolSelector(false)  # graph input
